# Dynamo graph Script удаления параметров.dyn (Dynamo 2.12.1.8246)

# group: Штамп
# note: Скрипт предназначен для удаления параметров с проекта
# note: Script Удаления параметров из проекта.dyn
# Packages used in this script:
# TimeStamp : 2024/7/6 8:1

boolean = BoolSelector(false)
python_script = Python(IN[0]=boolean)  # IronPython2; unwired: IN[1]
# ---------- python_script.python (52 lines) ----------
# Загрузить стандартную библиотеку Python и библиотеку DesignScript
import clr
clr.AddReference('RevitAPI')
import Autodesk
from Autodesk.Revit.DB import *
clr.AddReference('RevitServices')
import RevitServices
from RevitServices.Persistence import DocumentManager
from RevitServices.Transactions import TransactionManager
clr.AddReference('ProtoGeometry')
from Autodesk.DesignScript.Geometry import *


doc				=	DocumentManager.Instance.CurrentDBDocument
uiapp			=	DocumentManager.Instance.CurrentUIApplication
app				=	uiapp.Application
# Введенные в этом узле данные сохраняется в виде списка в переменных IN.
dataEnteringNode = IN


TransactionManager.Instance.EnsureInTransaction(doc)

spElems = FilteredElementCollector(doc).OfClass(ParameterElement)

seParam = []

nameP = '11'
for i in spElems:
    
    defParameter = i.GetDefinition()
    if defParameter.Name.startswith(nameP):
        
        seParam.append(i)

        
TransactionManager.Instance.TransactionTaskDone()


TransactionManager.Instance.EnsureInTransaction(doc)
n = 0
while len(seParam) > n:
    try:
    
        doc.Delete(seParam[n].Id)
        n += 1
    except:
        pass

TransactionManager.Instance.TransactionTaskDone()

# Назначьте вывод переменной OUT.
OUT = seParam
# ----------------------------------------
watch = Watch(python_script)
