# Dynamo graph VC_Dynamo_Start_template.dyn (Dynamo 1.3.2.2480)

# group: str... - поиск в библиотеке нодов
# note: _________________________________________________________________________________________________________________

# group: Параметры типоразмера
categories = Categories("Windows")
all_elements_of_category = ElementsOfCategory(categories)
type = FamilyInstance.Type(all_elements_of_category)
string = StringInput("Описание")
getParameterValueByName = Element.GetParameterValueByName(element=type, parameterName=string)
watch = Watch(getParameterValueByName)
# note: Получим значение параметра типа "Описание" для стен
categories_2 = Categories("Walls")
all_elements_of_category_2 = ElementsOfCategory(categories_2)
string_2 = StringInput("Тип")
# note: getp...
getParameterValueByName_2 = Element.GetParameterValueByName(element=all_elements_of_category_2, parameterName=string_2)
string_3 = StringInput("Описание")
# note: setp...
getParameterValueByName_3 = Element.GetParameterValueByName(element=getParameterValueByName_2, parameterName=string_3)
watch_2 = Watch(getParameterValueByName_3)

# group: Форматы данных
# note: Core / Input
# note: Создание строки - str..
string_4 = StringInput("Это строка")
# note: Создание числа - num...
number = DoubleInput(10.5)
# note: Да/Нет - boo...
boolean = BoolSelector(false)
# note: Code Block (Design Script)
# Двойным щелчком мыши
code_block = CodeBlock {  }

# group: Фильтрация элементов
# note: Выберем все окна , для которых значение параметра "Комментарии" = "Нужные"
выберем_все_окна = Categories("Windows")
all_elements_of_category_3 = ElementsOfCategory(выберем_все_окна)
фильтруем_по_параметру = StringInput("Комментарии")
getParameterValueByName_4 = Element.GetParameterValueByName(element=all_elements_of_category_3, parameterName=фильтруем_по_параметру)
значение_параметра = StringInput("Нужные")
eq = getParameterValueByName_4 == значение_параметра
filterByBoolMask = List.FilterByBoolMask(list=getParameterValueByName_4, mask=eq)
искомые_элементы = Watch(filterByBoolMask.in)
watch_3 = Watch(filterByBoolMask.out)

# group: Выбор элементов в Revit
# note: categ...
categories_3 = Categories("Walls")
all_elements_of_category_4 = ElementsOfCategory(categories_3)
# note: lev...
levels = Levels("Уровень 1")
all_elements_at_level = ElementsAtLevel(levels)
# note: wal...
wall_types = WallTypes("Внутренние - Перегородка (2 час) 135мм")
floor_types = FloorTypes("Типовой пол - 400мм")
# note: Все элементы категории,
# размещенные в проекте
# note: Выбор рамкой
select_model_elements = DSModelElementsSelection()  # 3 picked in the model
# note: Все элементы на уровне
# note: Выбор вида
views = Views("Уровень 1")
# note: Тип стен
# note: Тип перекрытий
# note: Все элементы на активном виде
# - activ...
all_elements_in_active_view = ElementsInView()

# group: Перенос значения параметров
categories_4 = Categories("MechanicalEquipment")
all_elements_of_category_5 = ElementsOfCategory(categories_4)
# note: Перенос данных из параметра "Смещение" в параметр "О_Смещение".
code_block_2 = CodeBlock { "О_Смещение"; }
code_block_3 = CodeBlock { "Смещение"; }
getParameterValueByName_5 = Element.GetParameterValueByName(element=all_elements_of_category_5, parameterName=code_block_3)
setParameterByName = Element.SetParameterByName(element=all_elements_of_category_5, parameterName=code_block_2, value=getParameterValueByName_5)

# group: Сортировка элементов
categories_5 = Categories("Walls")
all_elements_of_category_6 = ElementsOfCategory(categories_5)
string_5 = StringInput("Комментарии")
getParameterValueByName_6 = Element.GetParameterValueByName(element=all_elements_of_category_6, parameterName=string_5)
# note: Сортировка по ключам - sor k...
sortByKey = List.SortByKey(list=all_elements_of_category_6, keys=getParameterValueByName_6)
categories_6 = Categories("Walls")
all_elements_of_category_7 = ElementsOfCategory(categories_6)
string_6 = StringInput("Длина")
getParameterValueByName_7 = Element.GetParameterValueByName(element=all_elements_of_category_7, parameterName=string_6)
# note: li sor...
sort = List.Sort(getParameterValueByName_7)
categories_7 = Categories("Walls")
all_elements_of_category_8 = ElementsOfCategory(categories_7)
string_7 = StringInput("Неприсоединенная высота")
# note: Высоты всех стен в списке в порядке создания стены в проекте
getParameterValueByName_8 = Element.GetParameterValueByName(element=all_elements_of_category_8, parameterName=string_7)
# note: Получим индексы элементов стены в порядке возрастания
boolean_2 = BoolSelector(true)
sortIndexByValue = SortIndexByValue(getParameterValueByName_8, boolean_2)
# note: Выстроим список стен по полученным индексам = стены в порядке увеличения высоты
getItemAtIndex = List.GetItemAtIndex(list=all_elements_of_category_8, index=sortIndexByValue)
# note: Высоты стен в порядке возрастания
getParameterValueByName_9 = Element.GetParameterValueByName(element=getItemAtIndex, parameterName=string_7)

# group: Операции со строками
# note: Числов в строку - str to...
code_block_4 = CodeBlock { 3; }
string_from_object = FromObject(code_block_4)
watch_4 = Watch(string_from_object)
# note: Длину элемента модели в строку
select_model_element = DSModelElementSelection()  # 1 picked in the model
string_8 = StringInput("Длина")
# note: getp...
getParameterValueByName_10 = Element.GetParameterValueByName(element=select_model_element, parameterName=string_8)
string_from_object_2 = FromObject(getParameterValueByName_10)
watch_5 = Watch(string_from_object_2)
# note: Список в строку
code_block_5 = CodeBlock { {4,6,8}; }
string_from_object_3 = FromObject(code_block_5)
# note: Подсчет числа символов в строке
string_9 = StringInput("Сколько символов в строке?")
# note: str le...
length = String.Length(string_9)
watch_6 = Watch(length)
# note: Сложение строк из списка
code_block_6 = CodeBlock { {4,6,8}; }
string_from_object_4 = FromObject(code_block_6)
concat = String.Concat(string_from_object_4)
watch_7 = Watch(concat)
# note: Поиск содержимого в строке
string_10 = StringInput("Что есть в строке?")
code_block_7 = CodeBlock { "что"; }
boolean_3 = BoolSelector(true)
contains = String.Contains(str=string_10, searchFor=code_block_7, ignoreCase=boolean_3)
watch_8 = Watch(contains)
# note: Сложение строк - str cont...
code_block_8 = CodeBlock { "Первая"; }
code_block_9 = CodeBlock { " и вторая"; }
concat_2 = String.Concat(code_block_8, code_block_9)
watch_9 = Watch(concat_2)
# note: Сложение строк на Design Script
code_block_10 = CodeBlock { "Первая"; }
code_block_11 = CodeBlock { "вторая"; }
code_block_12 = CodeBlock(a=code_block_10, b=code_block_11) { a+" и "+b; }
watch_10 = Watch(code_block_12)

# group: Работа с числами
# note: Создать число -num...
number_2 = DoubleInput(5.06)
number_slider = DoubleSlider(29.8, range=0..100 step 0.1)
string_11 = StringInput("12.90")
toNumber = String.ToNumber(string_11)
integer_slider = IntegerSlider(1, range=0..100 step 1)
# note: Модуль числа
# note: Последовательность
# Code Block
code_block_13 = CodeBlock { 1..12..3; }
code_block_14 = CodeBlock { 1; }
code_block_15 = CodeBlock { 4; }
code_block_16 = CodeBlock { 3; }
# note: Последовательность - seq...
sequence = Sequence(start=code_block_14, amount=code_block_15, step=code_block_16, lacing=Longest)
number_3 = DoubleInput(5.06)
# note: Округление на Code Block
code_block_17 = CodeBlock(a=number_3) { Math.Round(a); }
# note: Округление
round = Math.Round(number_3)
# note: Целое число
# note: Из строки в число - to num...
code_block_18 = CodeBlock { -10; }
abs = Math.Abs(code_block_18)
# note: Модуль числа
# на Code Block
code_block_19 = CodeBlock(a=code_block_18) { Math.Abs(a); }

# group: Группировка элементов
categories_8 = Categories("Doors")
all_elements_of_category_9 = ElementsOfCategory(categories_8)
code_block_20 = CodeBlock { "Высота нижнего бруса"; }
getParameterValueByName_11 = Element.GetParameterValueByName(element=all_elements_of_category_9, parameterName=code_block_20)
# note: gr ke...
groupByKey = List.GroupByKey(list=all_elements_of_category_9, keys=getParameterValueByName_11)

# group: Операции со списками
# note: Работа со списками на примере Ширин и Высот дверей
categories_9 = Categories("Doors")
all_elements_of_category_10 = ElementsOfCategory(categories_9)
type_2 = FamilyInstance.Type(all_elements_of_category_10)
code_block_21 = CodeBlock { "Ширина"; }
getParameterValueByName_12 = Element.GetParameterValueByName(element=type_2, parameterName=code_block_21)
# note: Создание - li cr...
create = List.Create(getParameterValueByName_12)
code_block_22 = CodeBlock { "Высота"; }
getParameterValueByName_13 = Element.GetParameterValueByName(element=type_2, parameterName=code_block_22)
create_2 = List.Create(getParameterValueByName_13)
# note: Объединение - li j...
join = List.Join(create, create_2)
# note: Траспонирование - li tra...
transpose = List.Transpose(join)
# note: Уравнивание- li fla...
flatten = Flatten(transpose)
# note: Число элементов- cou...
count = Count(transpose)

# group: Списки
# note: Design Script
code_block_23 = CodeBlock { {1,2,3}; }
# note: Список в Dynamo- это последовательность элементов. Элементы могут быть разных форматов.
# При работе с Revit списки - это список элементов стен, список ширин окон, список размеров воздуховодов. Все значения которые мы получаем от набора элементов Revit - это списки.
# В Dynamo мы можем управлять списками = управлять параметрами Revit элементов
code_block_24 = CodeBlock { 1; }
code_block_25 = CodeBlock { 2; }
code_block_26 = CodeBlock { 3; }
# note: Создание - li...
create_3 = List.Create(code_block_24, code_block_25, code_block_26)
code_block_27 = CodeBlock { 1..4; }
# note: Список из списков
code_block_28 = CodeBlock(a=code_block_23, b=create_3, c=code_block_27) { {a,b,c}; }

# group: Типы переплетений
code_block_29 = CodeBlock { 1..5; }
code_block_30 = CodeBlock { 5..12; }
add = code_block_29 + code_block_30
# note: | По короткому списку
add_2 = code_block_29 + code_block_30  # lacing=Longest
# note: ||\ По длинному списку
add_3 = code_block_29 + code_block_30  # lacing=CrossProduct
code_block_31 = CodeBlock { {1..3,4..5}; }
count_2 = Count(code_block_31)
count_3 = Count(code_block_31, lacing=Longest)
