# Dynamo graph Высотная отметка ОВ2 rvt_v22.dyn (Dynamo 2.12.0.5650)

# group: Штамп
# note: Скрипт предназначен для установки всем элементам ОВ2 уровень 1 этажа (для Собяниной Н.П.)
# note: Script Name: Высотная отметка ОВ2 rvt_v22
# Packages used in this script:
# TimeStamp : 2024/2/27 09:54

boolean = BoolSelector(false)  # graph input
python_script = Python(IN[0]=boolean)  # IronPython2
# ---------- python_script.python (129 lines) ----------
import clr
clr.AddReference('ProtoGeometry')
from Autodesk.DesignScript.Geometry import *

# Import DocumentManager and TransactionManager
clr.AddReference("RevitServices")
import RevitServices
from RevitServices.Persistence import DocumentManager
from RevitServices.Transactions import TransactionManager

from System.Collections.Generic import *

# Import RevitAPI
clr.AddReference("RevitAPI")
import Autodesk
from Autodesk.Revit.DB import *
from Autodesk.Revit.DB.Analysis import *

doc = DocumentManager.Instance.CurrentDBDocument
uiapp = DocumentManager.Instance.CurrentUIApplication
app = uiapp.Application
groups = doc.Settings.Categories

# Import ToDSType(bool) extension method
clr.AddReference("RevitNodes")
import Revit
clr.ImportExtensions(Revit.Elements)
#The inputs to this node will be stored as a list in the IN variable.


def FZL(mas):
	zeroLevel = ""
	for level1 in mas:
		if level1.GetParameters('Фасад')[0].AsDouble() == 0:
			zeroLevel = level1
			break
	return zeroLevel
			
#________________________________________________________________________
pipe_f		= ElementCategoryFilter(BuiltInCategory.OST_DuctCurves)
pipeIsole_f	= ElementCategoryFilter(BuiltInCategory.OST_DuctInsulations)
flexPipe_f	= ElementCategoryFilter(BuiltInCategory.OST_FlexDuctCurves)

line_filter_mas	=	[]
line_filter_mas.append(pipe_f)
line_filter_mas.append(pipeIsole_f)
line_filter_mas.append(flexPipe_f)
#________________________________________________________________________

pipeFitting_f			= ElementCategoryFilter(BuiltInCategory.OST_DuctFitting)
#mechanicalEquipment_f	= ElementCategoryFilter(BuiltInCategory.OST_DuctTerminal)
#pipeaccs_f				= ElementCategoryFilter(BuiltInCategory.OST_PipeAccessory)
#PlumbingFixtures_f		= ElementCategoryFilter(BuiltInCategory.OST_PlumbingFixtures)

line_filter_mas2=[]

line_filter_mas2.append(pipeFitting_f)
#line_filter_mas2.append(mechanicalEquipment_f)
#line_filter_mas2.append(pipeaccs_f)
#line_filter_mas2.append(PlumbingFixtures_f)
#________________________________________________________________________

#mechlEquip_f=ElementCategoryFilter(BuiltInCategory.OST_MechanicalEquipment)
#santech_f=ElementCategoryFilter(BuiltInCategory.OST_PlumbingFixtures)
#sprinklers_f=ElementCategoryFilter(BuiltInCategory.OST_Sprinklers)

#line_filter_mas3=[]
#line_filter_mas3.append(mechlEquip_f)
#line_filter_mas3.append(santech_f)
#line_filter_mas3.append(sprinklers_f)

#________________________________________________________________________
#---------------------------------

#categoriesSTR = UnwrapElement(IN[1])

#--------------------------------

collector = Autodesk.Revit.DB.FilteredElementCollector(doc)
levelfilter = ElementCategoryFilter(BuiltInCategory.OST_Levels)
mas=collector.WherePasses(levelfilter).WhereElementIsNotElementType().ToElements()


TransactionManager.Instance.EnsureInTransaction(doc)

bag=[]
levelMas0=[]
linemas01=[]
linemas0=[]
basaLevelId = FZL(mas).Id

for filter in line_filter_mas:
	collector = FilteredElementCollector(doc)
	lineMas0=collector.WherePasses(filter).WhereElementIsNotElementType().ToElements()
	for i in lineMas0:
		try:
			i.GetParameters('Базовый уровень')[0].Set(basaLevelId)
		except:
			pass

for filter in line_filter_mas2:
	collector = FilteredElementCollector(doc)
	for i in collector.WherePasses(filter).WhereElementIsNotElementType().ToElements():
		try:
			i.GetParameters('Уровень')[1].Set(basaLevelId)
			bag.append(1)
		except:
			bag.append(2)
			#pass
			
mastest = []		
"""
for filter in line_filter_mas3:
	collector = FilteredElementCollector(doc)
	for i in collector.WherePasses(filter).WhereElementIsNotElementType().ToElements():
		try:
			Hight = int(i.LookupParameter('Отметка от уровня').AsValueString())/304.8
			LocZ = i.Location.Point.Z 
			
			i.GetParameters('Уровень')[1].Set(basaLevelId)
			mastest.append([Hight, LocZ,i.Id])
			i.LookupParameter('Отметка от уровня').Set(LocZ)
		except:
			pass
"""
TransactionManager.Instance.TransactionTaskDone()


OUT = bag
# ----------------------------------------
watch = Watch(python_script)
