# Dynamo graph Заменая значения определенного параметра rvt_v22.dyn (Dynamo 2.12.0.5650)

# group: Штамп
# note: Скрипт предназначен для реадктирования значения определенного параметра ОВ2
# note: Script Name: Заменая значения определенного параметра rvt_v22
# Packages used in this script:
# TimeStamp : 2024/2/27 9:40

boolean = BoolSelector(false)  # graph input
список_категорий = StringInput("""["Воздуховоды","Соединительные детали воздуховодов", "Арматура воздуховодов",
"Воздухораспределители", "Гибкие воздуховоды", "Материалы изоляции воздуховодов",
"Оборудование", ""];""")  # graph input
параметр_в_которы_пишем = StringInput("\"ИмяСистемы\";")  # graph input
параметр_из_которого_читаем = StringInput("\"Имя системы\";")  # graph input
python_script = Python(IN[0]=boolean, IN[1]=список_категорий, IN[2]=параметр_в_которы_пишем, IN[3]=параметр_из_которого_читаем)  # IronPython2
# ---------- python_script.python (53 lines) ----------
import clr
clr.AddReference('ProtoGeometry')
from Autodesk.DesignScript.Geometry import *

# Import DocumentManager and TransactionManager
clr.AddReference("RevitServices")
import RevitServices
from RevitServices.Persistence import DocumentManager
from RevitServices.Transactions import TransactionManager

from System.Collections.Generic import *

# Import RevitAPI
clr.AddReference("RevitAPI")
import Autodesk
from Autodesk.Revit.DB import *
from Autodesk.Revit.DB.Analysis import *

doc = DocumentManager.Instance.CurrentDBDocument
uiapp = DocumentManager.Instance.CurrentUIApplication
app = uiapp.Application
groups = doc.Settings.Categories
# Import ToDSType(bool) extension method
clr.AddReference("RevitNodes")
import Revit
clr.ImportExtensions(Revit.Elements)

#The inputs to this node will be stored as a list in the IN variable.

#---------------------------------
test=[]
categoriesSTR =	IN[1]	
parametrName =	IN[2]	
valueFromElement =	IN[3]	
#--------------------------------

collector = Autodesk.Revit.DB.FilteredElementCollector(doc)


TransactionManager.Instance.EnsureInTransaction(doc)
for i in groups:
	for i2 in categoriesSTR:
		if i2.Contains(i.Name):			
			collector = FilteredElementCollector(doc)
			mas=collector.OfCategoryId(i.Id).WhereElementIsNotElementType().ToElements()
			for i1 in mas:
				pr=i1.GetParameters(valueFromElement )[0].AsString()
				i1.GetParameters(parametrName)[0].Set(pr)
TransactionManager.Instance.TransactionTaskDone()					
#t=i2.Id
#t1=dir(t)

OUT = 1
# ----------------------------------------
watch = Watch(python_script)
параметр_из_которого_читаем_2 = CodeBlock { "Имя системы"; }
параметр_в_которы_пишем_2 = CodeBlock { "ИмяСистемы"; }
список_категорий_2 = CodeBlock()
# ---------- список_категорий_2.designscript (3 lines) ----------
["Воздуховоды","Соединительные детали воздуховодов", "Арматура воздуховодов",
"Воздухораспределители", "Гибкие воздуховоды", "Материалы изоляции воздуховодов",
"Оборудование", ""];
# ----------------------------------------
