# Dynamo graph Запись параметра 3 rvt_v22.dyn "Запись параметра 3" (Dynamo 2.12.0.5650)

# group: Штамп
# note: Скрипт предназначен для дублирования значения параметра из одного в другой
# note: Script Name: Запись параметра rvt_v22
# Packages used in this script:
# TimeStamp : 2024/2/27 09:55

boolean = BoolSelector(true)  # graph input
список_категорий = StringInput("Воздуховоды")  # graph input
список_категорий_2 = StringInput("Соединительные детали воздуховодов")  # graph input
список_категорий_3 = StringInput("Арматура воздуховодов")  # graph input
список_категорий_4 = StringInput("Воздухораспределители")  # graph input
список_категорий_5 = StringInput("Гибкие воздуховоды")  # graph input
список_категорий_6 = StringInput("Материалы изоляции воздуховодов")  # graph input
список_категорий_7 = StringInput("Оборудование")  # graph input
список_категорий_8 = StringInput("...")  # graph input
список_категорий_9 = StringInput("...")  # graph input
list_create = List.Create(item0=список_категорий, item1=список_категорий_2, item2=список_категорий_3, item3=список_категорий_4, item4=список_категорий_5, item5=список_категорий_6, item6=список_категорий_7, item7=список_категорий_8, item8=список_категорий_9)
параметр_в_которы_пишем = StringInput("MVS_Имя_Системы")  # graph input
параметр_из_которого_читаем = StringInput("Имя системы")  # graph input
python_script = Python(IN[0]=boolean, IN[1]=list_create, IN[2]=параметр_в_которы_пишем, IN[3]=параметр_из_которого_читаем)  # IronPython2
# ---------- python_script.python (75 lines) ----------
import clr
clr.AddReference('ProtoGeometry')
from Autodesk.DesignScript.Geometry import *

# Import DocumentManager and TransactionManager
clr.AddReference("RevitServices")
import RevitServices
from RevitServices.Persistence import DocumentManager
from RevitServices.Transactions import TransactionManager

from System.Collections.Generic import *

# Import RevitAPI
clr.AddReference("RevitAPI")
import Autodesk
from Autodesk.Revit.DB import *
from Autodesk.Revit.DB.Analysis import *

doc = DocumentManager.Instance.CurrentDBDocument
uiapp = DocumentManager.Instance.CurrentUIApplication
app = uiapp.Application
groups = doc.Settings.Categories
# Import ToDSType(bool) extension method
clr.AddReference("RevitNodes")
import Revit
clr.ImportExtensions(Revit.Elements)
#The inputs to this node will be stored as a list in the IN variable.

#---------------------------------
test=[]
test2 = []
test3 = []
categoriesSTR = UnwrapElement(IN[1])
parametrName = UnwrapElement(IN[2])
valueFromElement = UnwrapElement(IN[3])
#--------------------------------

collector = Autodesk.Revit.DB.FilteredElementCollector(doc)


TransactionManager.Instance.EnsureInTransaction(doc)


for i in groups:
	
	for i2 in categoriesSTR:
		
		if i.Name in i2:	
					
			collector = FilteredElementCollector(doc)
			mas=collector.OfCategoryId(i.Id).WhereElementIsNotElementType().ToElements()
			for i1 in mas:
				try:		
					pr=i1.GetParameters(valueFromElement)[0].AsString()
						
					kl = i1.LookupParameter(parametrName).Set(str(pr))
					test3.append(kl)
				except:
					test2.append(i1)
				
TransactionManager.Instance.TransactionTaskDone()


#t=i2.Id
#t1=dir(t)
"""
d = []
for i in groups:
    
    for j in categoriesSTR:
    
    	if i.Name in j:
    		d.append(type(i.Name))
"""
OUT = test3
# ----------------------------------------
watch = Watch(python_script)
параметр_из_которого_читаем_2 = CodeBlock { "Имя системы"; }
параметр_в_которы_пишем_2 = CodeBlock { "ИмяСистемы"; }
список_категорий_10 = CodeBlock()
# ---------- список_категорий_10.designscript (3 lines) ----------
["Воздуховоды","Соединительные детали воздуховодов", "Арматура воздуховодов",
"Воздухораспределители", "Гибкие воздуховоды", "Материалы изоляции воздуховодов",
"Оборудование", ""];
# ----------------------------------------
code_block = CodeBlock {  }
