# Dynamo graph Копирование параметров.dyn (Dynamo 1.3.4.6666)

categories = Categories("MEPSpaces")
watch = Watch(categories)
boolean = BoolSelector(false)
python_script = Python(IN[0]=watch, IN[1]=boolean)
# ---------- python_script.python (97 lines) ----------
# Загрузить стандартную библиотеку Python и библиотеку DesignScript

import sys
import clr

clr.AddReference('ProtoGeometry')
from Autodesk.DesignScript.Geometry import *
clr.AddReference('RevitAPI')
import Autodesk
from Autodesk.Revit.DB import *
clr.AddReference("RevitServices")
import RevitServices
from RevitServices.Persistence import DocumentManager
from RevitServices.Transactions import TransactionManager

#----------------------------------------------

# Введенные в этом узле данные сохраняется в виде списка в переменных IN.
dataEnteringNode = IN
cat = UnwrapElement(IN[0])


# Разместите код под этой строкой
doc = DocumentManager.Instance.CurrentDBDocument
uiapp = DocumentManager.Instance.CurrentUIApplication
app = uiapp.Application

TransactionManager.Instance.EnsureInTransaction(doc)



koef=0.3048*0.3048 # перевод кв. футы в кв. м.
kf3 = 0.3048*0.3048*0.3048 # перевод куб. футы в куб. м.
kf = 0.3048 # перевод футы в м.
el = FilteredElementCollector(doc).OfCategoryId(cat.Id).WhereElementIsNotElementType().ToElements()
error=[]

change_param=[]
for i in el:
#_________________________________________________________________________________________________________________________________________________
	shorttimepar1 = i.GetParameters("Номер помещения")[0].AsString()
	i.GetParameters("ВН_номер_помещения_текст")[0].Set(shorttimepar1)
#_________________________________________________________________________________________________________________________________________________	
	shorttimepar2 = i.GetParameters("Имя помещения")[0].AsString()
	i.GetParameters("ВН_наим_помещ")[0].Set(shorttimepar2)
#_________________________________________________________________________________________________________________________________________________	
	shorttimepar3 = i.GetParameters("Площадь")[0].AsDouble()
	change_param.append(shorttimepar3)
	try:
		i.LookupParameter("BH_площадь").Set(shorttimepar3*koef)
		#i.LookupParameter("Комментарии").Set(str(i.LookupParameter("BH_площадь").AsDouble()))
	except:
		error.append(i)
#_________________________________________________________________________________________________________________________________________________	
	shorttimepar4 = i.GetParameters("Полная высота")[0].AsDouble()
	i.GetParameters("ВН_высота")[0].Set(shorttimepar4*kf)
#_________________________________________________________________________________________________________________________________________________	
	shorttimepar5 = i.GetParameters("Объем")[0].AsDouble()
	i.GetParameters("ВН_объем_помещения")[0].Set(shorttimepar5*kf3)

#_________________________________________________________________________________________________________________________________________________

	if (i.GetParameters("ВН_тр_кр_приток")[0].AsDouble() == 0) or (i.GetParameters("ВН_кратность_или_пр-выт")[0].AsInteger() == 1):
		
		shorttimepar6 = i.GetParameters("ВН_приток_всего")[0].AsDouble()/(i.GetParameters("Объем")[0].AsDouble()*kf3)
		i.GetParameters("ВН_тр_кр_приток")[0].Set(shorttimepar6)
	elif (i.GetParameters("ВН_тр_кр_приток")[0].AsDouble() != 0) or (i.GetParameters("ВН_кратность_или_пр-выт")[0].AsInteger() != 1):
		
		shorttimepar6 = i.GetParameters("ВН_тр_кр_приток")[0].AsDouble()*(i.GetParameters("Объем")[0].AsDouble()*kf3)
		i.GetParameters("ВН_приток_всего")[0].Set(shorttimepar6)
	elif (i.GetParameters("ВН_тр_кр_приток")[0].AsDouble() != 0) and (i.GetParameters("ВН_приток_всего")[0].AsDouble() != 0):
		pass

#_________________________________________________________________________________________________________________________________________________

	if (i.GetParameters("ВН_тр_кр_вытяжка")[0].AsDouble() == 0) or (i.GetParameters("ВН_кратность_или_пр-выт")[0].AsInteger() == 1):
		
		shorttimepar7 = i.GetParameters("ВН_вытяжка_всего")[0].AsDouble()/(i.GetParameters("Объем")[0].AsDouble()*kf3)
		i.GetParameters("ВН_тр_кр_вытяжка")[0].Set(shorttimepar7)
		
	elif (i.GetParameters("ВН_тр_кр_вытяжка")[0].AsDouble() != 0) or (i.GetParameters("ВН_кратность_или_пр-выт")[0].AsInteger() != 1):
		
		shorttimepar7 = i.GetParameters("ВН_тр_кр_вытяжка")[0].AsDouble()*(i.GetParameters("Объем")[0].AsDouble()*kf3)
		i.GetParameters("ВН_вытяжка_всего")[0].Set(shorttimepar7)
		
	elif (i.GetParameters("ВН_тр_кр_вытяжка")[0].AsDouble() != 0) and (i.GetParameters("ВН_вытяжка_всего")[0].AsDouble() != 0):
		pass
	
#_________________________________________________________________________________________________________________________________________________
	
"""
t = el[0].GetParameters("ВН_номер_помещения")[0]
t2 = t.Set(333)
t1=dir(t2)
"""
TransactionManager.Instance.ForceCloseTransaction()	
OUT = error
# ----------------------------------------
watch_2 = Watch(python_script)
