# Dynamo graph Округление отверстий rvt_v22.dyn (Dynamo 2.12.0.5650)

# group: Штамп
# note: Скрипт предназначен для изменения размера отверстий
# note: Script Name: Округление отверстий rvt_v22
# Packages used in this script:
# TimeStamp : 2024/2/27 09:52

boolean = BoolSelector(true)  # graph input
python_script = Python(IN[0]=boolean)  # IronPython2
# ---------- python_script.python (74 lines) ----------
import clr
clr.AddReference('ProtoGeometry')
from Autodesk.DesignScript.Geometry import *

# Import DocumentManager and TransactionManager
clr.AddReference("RevitServices")
import RevitServices
from RevitServices.Persistence import DocumentManager
from RevitServices.Transactions import TransactionManager

from System.Collections.Generic import *

# Import RevitAPI
clr.AddReference("RevitAPI")
import Autodesk
from Autodesk.Revit.DB import *
from Autodesk.Revit.DB.Analysis import *

doc = DocumentManager.Instance.CurrentDBDocument
uiapp = DocumentManager.Instance.CurrentUIApplication
app = uiapp.Application

#groups = doc.Settings.Categories

# Import ToDSType(bool) extension method
clr.AddReference("RevitNodes")
import Revit
clr.ImportExtensions(Revit.Elements)
#The inputs to this node will be stored as a list in the IN variable.



			
#________________________________________________________________________

#________________________________________________________________________
#---------------------------------

#categoriesSTR = UnwrapElement(IN[1])

#-------------------------------- .LookupParameter(parametrName).Set(str(pr)) .GetParameters(valueFromElement)[0].AsString()

collector = FilteredElementCollector(doc) 
Generic_F = ElementCategoryFilter(BuiltInCategory.OST_GenericModel)
generic=collector.WherePasses(Generic_F).WhereElementIsNotElementType().ToElements()

testx = []
testy = []

TransactionManager.Instance.EnsureInTransaction(doc)

for g in generic:
	try:
		if g.LookupParameter('ST45_Дисциплина').AsString() != 0:

			#x = ((g.LookupParameter('X').AsDouble()*304.8) + 5)
			#testx.append(x/304.8)
			
			#x = g.LookupParameter('X').AsDouble()*304.8+5
			x = (int(g.LookupParameter('X').AsDouble()*304.8) + 105)/304.8
			y = (int(g.LookupParameter('Y').AsDouble()*304.8) + 105)/304.8
			
			g.LookupParameter('X').Set(x)
			g.LookupParameter('Y').Set(y)
			#test.append(g.LookupParameter('Z'))
	except:
		pass
		
TransactionManager.Instance.ForceCloseTransaction()




OUT = testx
# ----------------------------------------
watch = Watch(python_script)
