# Dynamo graph Параметр BH_обозн_сист.dyn (Dynamo 2.12.1.8246)

# group: Штамп
# note: Скрипт предназначен для установки всем элементам ОВ2 уровень 1 этажа (для Собяниной Н.П.)
# note: Script Name: Высотная отметка ОВ2 rvt_v22
# Packages used in this script:
# TimeStamp : 2024/2/27 09:54

boolean = BoolSelector(true)  # graph input
python_script = Python(IN[0]=boolean)  # IronPython2; frozen
# ---------- python_script.python (76 lines) ----------
import clr
clr.AddReference('ProtoGeometry')
from Autodesk.DesignScript.Geometry import *

# Import DocumentManager and TransactionManager
clr.AddReference("RevitServices")
import RevitServices
from RevitServices.Persistence import DocumentManager
from RevitServices.Transactions import TransactionManager

from System.Collections.Generic import *

# Import RevitAPI
clr.AddReference("RevitAPI")
import Autodesk
from Autodesk.Revit.DB import *
from Autodesk.Revit.DB.Analysis import *

doc = DocumentManager.Instance.CurrentDBDocument
uiapp = DocumentManager.Instance.CurrentUIApplication
app = uiapp.Application
#groups = doc.Settings.Categories

# Import ToDSType(bool) extension method
clr.AddReference("RevitNodes")
import Revit
clr.ImportExtensions(Revit.Elements)
#The inputs to this node will be stored as a list in the IN variable.
#---------------------------------

#categoriesSTR = UnwrapElement(IN[1])



#--------------------------------

collector = Autodesk.Revit.DB.FilteredElementCollector(doc)
machinefilter = ElementCategoryFilter(BuiltInCategory.OST_MechanicalEquipment)
mas=collector.WherePasses(machinefilter).WhereElementIsNotElementType().ToElements()


TransactionManager.Instance.EnsureInTransaction(doc)

bag=[]



for element in mas:
    try:
    	k = '022'
    	adskZavod = element.LookupParameter('ADSK_Завод-изготовитель').AsString()
    	k = '01'
    	nameTypeFamily = element.Name
    	k = '02'
        nameSystem = element.LookupParameter('Имя системы').AsString()
        k = '03'
        sokrNameSystem = element.LookupParameter('Сокращение для системы').AsString()
        k = '04'
        if len(nameSystem) < 5 and adskZavod != 'VENTZ':
        	k = '1'
        	element.GetParameters('BH_обозн_сист')[0].Set(sokrNameSystem)
        	k = '2'
        elif adskZavod == 'VENTZ':
        	k = '3'
        	element.GetParameters('BH_обозн_сист')[0].Set(nameSystem.replace("_", " "))
        	k = '4'
        elif len(nameSystem) > 5:
        	k = '5'
        	element.GetParameters('BH_обозн_сист')[0].Set(nameTypeFamily)       
    except:
        bag.append(element.Name + " не имеет параметра 'Имя системы'" + ' ' + k)
        bag.append(element.Id)
TransactionManager.Instance.TransactionTaskDone()


OUT = bag
# ----------------------------------------
python_script_2 = Python(IN[0]=boolean)  # IronPython2
# ---------- python_script_2.python (68 lines) ----------
import clr
clr.AddReference('ProtoGeometry')
from Autodesk.DesignScript.Geometry import *

# Import DocumentManager and TransactionManager
clr.AddReference("RevitServices")
import RevitServices
from RevitServices.Persistence import DocumentManager
from RevitServices.Transactions import TransactionManager

from System.Collections.Generic import *

# Import RevitAPI
clr.AddReference("RevitAPI")
import Autodesk
from Autodesk.Revit.DB import *
from Autodesk.Revit.DB.Analysis import *

doc = DocumentManager.Instance.CurrentDBDocument
uiapp = DocumentManager.Instance.CurrentUIApplication
app = uiapp.Application
#groups = doc.Settings.Categories

# Import ToDSType(bool) extension method
clr.AddReference("RevitNodes")
import Revit
clr.ImportExtensions(Revit.Elements)
#The inputs to this node will be stored as a list in the IN variable.
#---------------------------------

#categoriesSTR = UnwrapElement(IN[1])



#--------------------------------

collector = Autodesk.Revit.DB.FilteredElementCollector(doc)
machinefilter = ElementCategoryFilter(BuiltInCategory.OST_MechanicalEquipment)
mas=collector.WherePasses(machinefilter).WhereElementIsNotElementType().ToElements()


TransactionManager.Instance.EnsureInTransaction(doc)

bag=[]

for element in mas:
    try:
        nameSystemParam = element.LookupParameter('Имя системы')
        if nameSystemParam:
            nameSystem = nameSystemParam.AsString()
            if len(nameSystem) < 7:
                try:
                    element.GetParameters('BH_обозн_сист')[0].Set(nameSystem.replace("_", " "))
                except:
                    bag.append(element.Name)
                    bag.append(element.Id)
            elif len(nameSystem) > 7:
                bh = "ПВ"+ ' ' + nameSystem[2:3]
                try:
                    element.GetParameters('BH_обозн_сист')[0].Set(bh)
                except:
                    bag.append(element.Name)
                    bag.append(element.Id)
        else:
            bag.append(element.Name + " не имеет параметра 'Имя системы'")
    except Exception as e:
        bag.append(str(e))
OUT = bag
# ----------------------------------------
watch = Watch(python_script_2)
boolean_2 = BoolSelector(true)
file_path = Filename("..\..\01_Входящие\01_КО_931-S_СУРГУТ_ЛАБОРАТОРИЯ_ПРОЕКТИРОВАНИЕ_СТАДИЯ\new_step_170124\ОВ2\DWG\2024.01.22\Оборудование\02_HT_Сургут_ХОВС для экспорта.xlsm")  # frozen
file_from_path = FileObject(path=file_path)
string = StringInput("ХОВС_НА ПЕЧАТЬ")
boolean_3 = BoolSelector(true)
boolean_4 = BoolSelector(true)
importExcel = Data.ImportExcel(file=file_from_path, sheetName=string, readAsStrings=boolean_3, showExcel=boolean_4)  # frozen
watch_2 = Watch(importExcel)
python_script_3 = Python(IN[0]=boolean_2, IN[1]=watch_2)  # IronPython2
# ---------- python_script_3.python (76 lines) ----------
import clr
clr.AddReference('ProtoGeometry')
from Autodesk.DesignScript.Geometry import *

# Import DocumentManager and TransactionManager
clr.AddReference("RevitServices")
import RevitServices
from RevitServices.Persistence import DocumentManager
from RevitServices.Transactions import TransactionManager

from System.Collections.Generic import *

# Import RevitAPI
clr.AddReference("RevitAPI")
import Autodesk
from Autodesk.Revit.DB import *
from Autodesk.Revit.DB.Analysis import *

#---------------------------------


exelList=UnwrapElement(IN[1])


#---------------------------------
doc = DocumentManager.Instance.CurrentDBDocument
uiapp = DocumentManager.Instance.CurrentUIApplication
app = uiapp.Application
#groups = doc.Settings.Categories

# Import ToDSType(bool) extension method
clr.AddReference("RevitNodes")
import Revit
clr.ImportExtensions(Revit.Elements)
#The inputs to this node will be stored as a list in the IN variable.
#---------------------------------

#categoriesSTR = UnwrapElement(IN[1])



#--------------------------------
"""
collector = Autodesk.Revit.DB.FilteredElementCollector(doc)
machinefilter = ElementCategoryFilter(BuiltInCategory.OST_MechanicalEquipment)
mas=collector.WherePasses(machinefilter).WhereElementIsNotElementType().ToElements()


TransactionManager.Instance.EnsureInTransaction(doc)

bag=[]



for element in mas:

	try:
		nameSystem = element.LookupParameter('Имя системы').AsString
		try:
			element.GetParameters('BH_обозн_сист')[0].Set(element.Name)
		except:
			bag.append(element.Name)
	except:
		bag.append(1)
		

TransactionManager.Instance.TransactionTaskDone()
"""
b = exelList[8][4]
resultList2 = [row for row in exelList if row[4] == "1" or row[4] == b or row[4] == "2"]
resultList = []
for i in resultList2:
	
	resultList.append(i[3])

OUT = resultList
# ----------------------------------------
watch_3 = Watch(python_script_3)
