# Dynamo graph Перенос параметров помещение - пространство ВН rvt_v22.dyn (Dynamo 2.12.1.8246)

# group: Штамп
# note: Скрипт предназначен для заполнения параметров ВН пространства для спецификации
# note: Script Name: Перенос параметров помещение - пространство ВН rvt_v22
# Packages used in this script:
# TimeStamp : 2024/2/27 9:43

categories = Categories("OST_MEPSpaces")  # graph input
watch = Watch(categories)
boolean = BoolSelector(true)  # graph input
python_script = Python(IN[0]=watch, IN[1]=boolean)  # IronPython2; frozen
# ---------- python_script.python (103 lines) ----------
# Загрузить стандартную библиотеку Python и библиотеку DesignScript
import sys
import clr

clr.AddReference('ProtoGeometry')
from Autodesk.DesignScript.Geometry import *
clr.AddReference('RevitAPI')
import Autodesk
from Autodesk.Revit.DB import *
clr.AddReference("RevitServices")
import RevitServices
from RevitServices.Persistence import DocumentManager
from RevitServices.Transactions import TransactionManager

# ----------------------------------------------

# Введенные в этом узле данные сохраняются в виде списка в переменных IN.
dataEnteringNode = IN
cat = UnwrapElement(IN[0])

# Разместите код под этой строкой
doc = DocumentManager.Instance.CurrentDBDocument
uiapp = DocumentManager.Instance.CurrentUIApplication
app = uiapp.Application

TransactionManager.Instance.EnsureInTransaction(doc)

koef = 0.3048 * 0.3048  # перевод кв. футы в кв. м.
kf3 = 0.3048 * 0.3048 * 0.3048  # перевод куб. футы в куб. м.
kf = 0.3048  # перевод футы в м.
el = FilteredElementCollector(doc).OfCategoryId(cat.Id).WhereElementIsNotElementType().ToElements()
error = []

change_param = []
for i in el:
    # _________
    shorttimepar1 = i.GetParameters("Номер помещения")[0].AsString()
    i.GetParameters("ВН_номер_помещения_текст")[0].Set(shorttimepar1)
    # _________
    shorttimepar2 = i.GetParameters("Имя помещения")[0].AsString()
    i.GetParameters("ВН_наим_помещ")[0].Set(shorttimepar2)
    # ________
    shorttimepar3 = i.GetParameters("Площадь")[0].AsDouble()
    shorttimepar3_1 = round(shorttimepar3 * koef, 1)
    change_param.append(shorttimepar3_1)
    try:
        i.LookupParameter("BH_площадь").Set(shorttimepar3_1)
        # i.LookupParameter("Комментарии").Set(str(i.LookupParameter("BH_площадь").AsDouble()))
    except:
        #error.append(i)
        pass
    # ____________
    shorttimepar4 = i.GetParameters("Полная высота")[0].AsDouble()
    i.GetParameters("ВН_высота")[0].Set(shorttimepar4 * kf)
    # ________
    shorttimepar5 = i.GetParameters("Объем")[0].AsDouble()
    shorttimepar5_1 = round(shorttimepar5 * kf3, 1)
    i.GetParameters("ВН_объем_помещения")[0].Set(shorttimepar5_1)

    # _______________
    if len(str(i.GetParameters("ВН_тр_кр_приток")[0].AsDouble())) > 4:
    	i.GetParameters("ВН_тр_кр_приток")[0].Set(0)
    if len(str(i.GetParameters("ВН_тр_кр_вытяжка")[0].AsDouble())) > 4:
    	i.GetParameters("ВН_тр_кр_вытяжка")[0].Set(0)
	try:
	    if (i.GetParameters("ВН_тр_кр_приток")[0].AsDouble() == 0) or (i.GetParameters("ВН_кратность_или_пр-выт")[0].AsInteger() == 1):
	        shorttimepar6 = i.GetParameters("ВН_приток_всего")[0].AsDouble() / (i.GetParameters("Объем")[0].AsDouble() * kf3)
	        shorttimepar6_1 = round(shorttimepar6, 1)
	        
	        i.GetParameters("ВН_тр_кр_приток")[0].Set(shorttimepar6_1)
	        error.append(type(shorttimepar6_1))
	    elif (i.GetParameters("ВН_тр_кр_приток")[0].AsDouble() != 0) or (i.GetParameters("ВН_кратность_или_пр-выт")[0].AsInteger() != 1):
	        shorttimepar6 = i.GetParameters("ВН_тр_кр_приток")[0].AsDouble() * (i.GetParameters("Объем")[0].AsDouble() * kf3)
	        shorttimepar6_1 = round(shorttimepar6, 1)
	        i.GetParameters("ВН_приток_всего")[0].Set(shorttimepar6_1)
	    elif (i.GetParameters("ВН_тр_кр_приток")[0].AsDouble() != 0) and (i.GetParameters("ВН_приток_всего")[0].AsDouble() != 0):
	        pass
    except:
        pass

    # _________
    if (i.GetParameters("ВН_тр_кр_вытяжка")[0].AsDouble() == 0) or (i.GetParameters("ВН_кратность_или_пр-выт")[0].AsInteger() == 1):
        shorttimepar7 = i.GetParameters("ВН_вытяжка_всего")[0].AsDouble() / (i.GetParameters("Объем")[0].AsDouble() * kf3)
        shorttimepar7_1 = round(shorttimepar7, 1)
        
        i.GetParameters("ВН_тр_кр_вытяжка")[0].Set(shorttimepar7_1)
        error.append(shorttimepar7_1)
    elif (i.GetParameters("ВН_тр_кр_вытяжка")[0].AsDouble() != 0) or (i.GetParameters("ВН_кратность_или_пр-выт")[0].AsInteger() != 1):
        shorttimepar7 = i.GetParameters("ВН_тр_кр_вытяжка")[0].AsDouble() * (i.GetParameters("Объем")[0].AsDouble() * kf3)
        shorttimepar7_1 = round(shorttimepar7, 1)
        #error.append(shorttimepar7_1)
        i.GetParameters("ВН_вытяжка_всего")[0].Set(shorttimepar7_1)
    elif (i.GetParameters("ВН_тр_кр_вытяжка")[0].AsDouble() != 0) and (i.GetParameters("ВН_вытяжка_всего")[0].AsDouble() != 0):
        pass
	
# _________
"""
t = el[0].GetParameters("ВН_номер_помещения")[0]
t2 = t.Set(333)
t1=dir(t2)
"""
TransactionManager.Instance.ForceCloseTransaction()
OUT = error
# ----------------------------------------
python_script_2 = Python(IN[0]=watch, IN[1]=boolean)  # IronPython2
# ---------- python_script_2.python (97 lines) ----------
# Загрузить стандартную библиотеку Python и библиотеку DesignScript
import sys
import clr

clr.AddReference('ProtoGeometry')
from Autodesk.DesignScript.Geometry import *
clr.AddReference('RevitAPI')
import Autodesk
from Autodesk.Revit.DB import *
clr.AddReference("RevitServices")
import RevitServices
from RevitServices.Persistence import DocumentManager
from RevitServices.Transactions import TransactionManager

# ----------------------------------------------

# Введенные в этом узле данные сохраняются в виде списка в переменных IN.
dataEnteringNode = IN
cat = UnwrapElement(IN[0])

# Разместите код под этой строкой
doc = DocumentManager.Instance.CurrentDBDocument
uiapp = DocumentManager.Instance.CurrentUIApplication
app = uiapp.Application

TransactionManager.Instance.EnsureInTransaction(doc)

koef = 0.3048 * 0.3048  # перевод кв. футы в кв. м.
kf3 = 0.3048 * 0.3048 * 0.3048  # перевод куб. футы в куб. м.
kf = 0.3048  # перевод футы в м.
el = FilteredElementCollector(doc).OfCategoryId(cat.Id).WhereElementIsNotElementType().ToElements()
error = []

change_param = []
for i in el:
    # _________
    shorttimepar1 = i.GetParameters("Номер помещения")[0].AsString()
    i.GetParameters("ВН_номер_помещения_текст")[0].Set(shorttimepar1)
    # _________
    shorttimepar2 = i.GetParameters("Имя помещения")[0].AsString()
    i.GetParameters("ВН_наим_помещ")[0].Set(shorttimepar2)
    # ________
    shorttimepar3 = i.GetParameters("Площадь")[0].AsDouble()
    shorttimepar3_1 = round(shorttimepar3 * koef, 1)
    change_param.append(shorttimepar3_1)
    try:
        i.LookupParameter("BH_площадь").Set(shorttimepar3_1)
        # i.LookupParameter("Комментарии").Set(str(i.LookupParameter("BH_площадь").AsDouble()))
    except:
        #error.append(i)
        pass
    # ____________
    shorttimepar4 = i.GetParameters("Полная высота")[0].AsDouble()
    i.GetParameters("ВН_высота")[0].Set(shorttimepar4 * kf)
    # ________
    shorttimepar5 = i.GetParameters("Объем")[0].AsDouble()
    shorttimepar5_1 = round(shorttimepar5 * kf3, 1)
    i.GetParameters("ВН_объем_помещения")[0].Set(shorttimepar5_1)

    # _______________
    if len(str(i.GetParameters("ВН_тр_кр_приток")[0].AsDouble())) > 4:
        i.GetParameters("ВН_тр_кр_приток")[0].Set(0)
    if len(str(i.GetParameters("ВН_тр_кр_вытяжка")[0].AsDouble())) > 4:
        i.GetParameters("ВН_тр_кр_вытяжка")[0].Set(0)
    try:
        if (i.GetParameters("ВН_тр_кр_приток")[0].AsDouble() == 0) or (i.GetParameters("ВН_кратность_или_пр-выт")[0].AsInteger() == 1):
            shorttimepar6 = i.GetParameters("ВН_приток_всего")[0].AsDouble() / (i.GetParameters("Объем")[0].AsDouble() * kf3)
            shorttimepar6_1 = round(shorttimepar6, 1)
            
            i.GetParameters("ВН_тр_кр_приток")[0].Set(shorttimepar6_1)
            error.append(type(shorttimepar6_1))
        elif (i.GetParameters("ВН_тр_кр_приток")[0].AsDouble() != 0) or (i.GetParameters("ВН_кратность_или_пр-выт")[0].AsInteger() != 1):
            shorttimepar6 = i.GetParameters("ВН_тр_кр_приток")[0].AsDouble() * (i.GetParameters("Объем")[0].AsDouble() * kf3)
            shorttimepar6_1 = round(shorttimepar6, 1)
            i.GetParameters("ВН_приток_всего")[0].Set(shorttimepar6_1)
        elif (i.GetParameters("ВН_тр_кр_приток")[0].AsDouble() != 0) and (i.GetParameters("ВН_приток_всего")[0].AsDouble() != 0):
            pass
    except:
        pass

    # _________
    if (i.GetParameters("ВН_тр_кр_вытяжка")[0].AsDouble() != 0) or (i.GetParameters("ВН_кратность_или_пр-выт")[0].AsInteger() != 1):
        shorttimepar7 = i.GetParameters("ВН_тр_кр_вытяжка")[0].AsDouble() * (i.GetParameters("Объем")[0].AsDouble() * kf3)
        shorttimepar7_1 = round(shorttimepar7, 1)
        #error.append(shorttimepar7_1)
        i.GetParameters("ВН_вытяжка_всего")[0].Set(shorttimepar7_1)
    elif (i.GetParameters("ВН_тр_кр_вытяжка")[0].AsDouble() != 0) and (i.GetParameters("ВН_вытяжка_всего")[0].AsDouble() != 0):
        pass
	
# _________
"""
t = el[0].GetParameters("ВН_номер_помещения")[0]
t2 = t.Set(333)
t1=dir(t2)
"""
TransactionManager.Instance.ForceCloseTransaction()
OUT = error
# ----------------------------------------
watch_2 = Watch(python_script_2)
