# Dynamo graph Проверка IsConnected ОВ2 rvt_v22.dyn (Dynamo 2.12.0.5650)

# group: Штамп
# note: Скрипт предназначен для проверки присоединянения вентиляционного оборудования
# note: Script Name: Проверка IsConnected ОВ2 rvt_v22
# Packages used in this script:
# TimeStamp : 2024/2/26 17:51

boolean = BoolSelector(true)
python_script = Python(IN[0]=boolean)  # IronPython2
# ---------- python_script.python (53 lines) ----------
# Загрузить стандартную библиотеку Python и библиотеку DesignScript
import sys
import clr
clr.AddReference('ProtoGeometry')
from Autodesk.DesignScript.Geometry import *
clr.AddReference('RevitAPI')
import Autodesk
from Autodesk.Revit.DB import *
clr.AddReference("RevitServices")
import RevitServices
from RevitServices.Persistence import DocumentManager
from RevitServices.Transactions import TransactionManager
from System.Collections.Generic import List

# Введенные в этом узле данные сохраняется в виде списка в переменных IN.
dataEnteringNode = IN

# Разместите код под этой строкой
doc = DocumentManager.Instance.CurrentDBDocument
uiapp = DocumentManager.Instance.CurrentUIApplication
app = uiapp.Application

duct_f = ElementCategoryFilter(BuiltInCategory.OST_DuctTerminal)
collector = FilteredElementCollector(doc)
duct = collector.WherePasses(duct_f).WhereElementIsNotElementType().ToElements()
b1 = [] 
duct2 = True
b = duct[0].MEPModel.ConnectorManager.Connectors
for i in b:
	b1.append(i)
	break

TransactionManager.Instance.EnsureInTransaction(doc)

for i in duct:
    for j in i.MEPModel.ConnectorManager.Connectors:
    	duct2 = j.IsConnected
    	break
    
    if duct2 == False:
    	
    	
    	
    	i.LookupParameter('ADSK_Примечание').Set("1")
    	b1.append(1)	
    else:
    	i.LookupParameter('ADSK_Примечание').Set("2")

    

TransactionManager.Instance.ForceCloseTransaction()
# Назначьте вывод переменной OUT.
OUT = b1[0]
# ----------------------------------------
watch = Watch(python_script)
