# Dynamo graph Создание рабочих наборов и присвоение связям rvt_v22.dyn (Dynamo 2.12.1.8246)

# group: Штамп
# note: Скрипт предназначен для создания рабочих наборов и присвоения их связным файлам
# note: Script Name: Создание рабочих наборов и присвоение связям rvt_v22
# Packages used in this script:
# TimeStamp : 2024/2/26 17:53

boolean = BoolSelector(true)  # graph input
python_script = Python(IN[0]=boolean)  # IronPython2
# ---------- python_script.python (94 lines) ----------
import clr
clr.AddReference('ProtoGeometry')
from Autodesk.DesignScript.Geometry import *

# Import DocumentManager and TransactionManager
clr.AddReference("RevitServices")
import RevitServices
from RevitServices.Persistence import DocumentManager
from RevitServices.Transactions import TransactionManager

from System.Collections.Generic import *

# Import RevitAPI
clr.AddReference("RevitAPI")
import Autodesk
from Autodesk.Revit.DB import *
from Autodesk.Revit.DB.Analysis import *

doc = DocumentManager.Instance.CurrentDBDocument
uiapp = DocumentManager.Instance.CurrentUIApplication
app = uiapp.Application

# Import ToDSType(bool) extension method
clr.AddReference("RevitNodes")
import Revit
clr.ImportExtensions(Revit.Elements)

#The inputs to this node will be stored as a list in the IN variable.
dataEnteringNode = IN
#-----------
Name_STR =  [
			"АИ","АР","ВК","КЖ","КМ","КР","ОВ1","ОВ2","СС","ТХ","ЭОМ",
			"AI","AR","VK","KJ","KM","KR","OV1","OV2","SS","TH","EOM","МГС","АУПТ"
			
			
			#"АР","КР","ОВ1","ОВ2","СС","ВК","АУПТ","ТС","АПС","ЭОМ",
			#"AR","KR","OV1","OV2","CC","VK","AUPT","TC","APS","ЭОМ","КМ","КЖ"	
				]
Name_RAS = ["#Связь_АИ","#Связь_АР","#Связь_ВК","#Связь_КЖ","#Связь_КМ","#Связь_КР","#Связь_ОВ1","#Связь_ОВ2","#Связь_СС","#Связь_ТХ","#Связь_ЭОМ","#Связь_МГС","#Связь_АУПТ","#Связь" ]

dist=UnwrapElement(Name_STR)
data=UnwrapElement(Name_RAS)

#---------------------------------
test=[]
test1=[]
test2 = []
#--------------------------------
worksetTable = doc.GetWorksetTable();
activeId = worksetTable.GetActiveWorksetId();
workset = worksetTable.GetWorkset(activeId);
fwc=FilteredWorksetCollector(doc)
workset_pr=fwc.OfKind(workset.Kind)

collector = Autodesk.Revit.DB.FilteredElementCollector(doc)
linkInstances = collector.OfClass(Autodesk.Revit.DB.RevitLinkInstance)

linkDoc, linkName, linkPath = [], [], []

TransactionManager.Instance.EnsureInTransaction(doc)
for linkName in data:
	try:
		a = Workset.Create(doc,linkName)
		test1.append(a)
	except:
		test.append(linkName)
linkDoc, linkName, linkPath = [], [], []
workset_svyz_id=0
for workset in workset_pr:
	if workset.Name=="#Связь":
		workset_svyz_id=workset.Id
for inst in linkInstances:
	linkDoc.append(inst.GetLinkDocument())
	linkName.append(inst.Name)
	inst.GetParameters('Рабочий набор')[0].Set(int(str(workset_svyz_id)))
      					
	try:
		linkPath.append(inst.GetLinkDocument().PathName)
	except:
		linkPath.append(None)
		pass
	for contaneName in dist:	
		if inst.Name.Contains(contaneName):
			for workset in workset_pr:
				if contaneName in workset.Name:
					inst.GetParameters('Рабочий набор')[0].Set(int(str(workset.Id)))
					break
		
      					
TransactionManager.Instance.TransactionTaskDone()					
#t=i2.Id
#t1=dir(t)

OUT = workset_svyz_id #linkDoc, linkName, linkInstances, linkPath,pipe_ov1,fiting_ov1,accses_ov1
# ----------------------------------------
watch = Watch(python_script)
