# Dynamo graph Формирования наименования изделий ОВ2 для спецификации v_1.2 rvt_v22.dyn (Dynamo 2.12.1.8246)

# group: Штамп
# note: Скрипт предназначен для формирования наименования изделий ОВ2 для спецификации v_1.2 rvt_v22
# note: Script Name: Формирования наименования изделий ОВ2 для спецификации v_1.2 rvt_v22
# Packages used in this script:
# TimeStamp : 2024/2/26 17:46

boolean = BoolSelector(false)  # graph input

# group: 3
code_block = CodeBlock { "3. Воздуховоды"; }
code_block_2 = CodeBlock { "6. Изоляция воздуховодов"; }
python_script = Python(IN[0]=code_block, IN[1]=code_block_2)  # IronPython2
# ---------- python_script.python (9 lines) ----------
import clr
clr.AddReference('ProtoGeometry')
from Autodesk.DesignScript.Geometry import *
#Введенные в этом узле данные сохраняется в виде списка в переменных IN.
dataEnteringNode = IN
el1 = IN[0]
el2 = IN[1]
#Назначьте вывод переменной OUT.
OUT = [el1, el2]
# ----------------------------------------

# group: Входные данные ВК
коэф_запаса = CodeBlock { 1.1; }
миним_диаметр_стояка = CodeBlock { 25; }
миним_высота_стояка = CodeBlock { 200; }

python_script_2 = Python(IN[0]=boolean, IN[1]=python_script, IN[2]=коэф_запаса, IN[3]=миним_диаметр_стояка, IN[4]=миним_высота_стояка)  # IronPython2
# ---------- python_script_2.python (266 lines) ----------
# Загрузить стандартную библиотеку Python и библиотеку DesignScript
import sys
import clr
clr.AddReference('ProtoGeometry')
from Autodesk.DesignScript.Geometry import *
clr.AddReference('RevitAPI')
import Autodesk
from Autodesk.Revit.DB import *
clr.AddReference("RevitServices")
import RevitServices
from RevitServices.Persistence import DocumentManager
from RevitServices.Transactions import TransactionManager
from System.Collections.Generic import List
import math
#from threading import Thread
import re
import time
#----------------------------------------------

#line___________________________________________________________
pipe_f=ElementCategoryFilter(BuiltInCategory.OST_DuctCurves)
pipeIsole_f=ElementCategoryFilter(BuiltInCategory.OST_DuctInsulations)
flexPipe_f=ElementCategoryFilter(BuiltInCategory.OST_FlexDuctCurves)
#-----------------------------------------------------------------

#massive_____________________________________________________________________
line_filter_mas=[]
line_filter_mas.append(pipe_f)
line_filter_mas.append(pipeIsole_f)
line_filter_mas.append(flexPipe_f)
# Введенные в этом узле данные сохраняется в виде списка в переменных IN.
dataEnteringNode = IN
ADSK_gr=UnwrapElement(IN[1])
koefZap=UnwrapElement(IN[2])
minD=UnwrapElement(IN[3])
minH=UnwrapElement(IN[4])
# Разместите код под этой строкой
doc = DocumentManager.Instance.CurrentDBDocument
uiapp = DocumentManager.Instance.CurrentUIApplication
app = uiapp.Application



k=0
#_Получение уровней________________________________________________
levelfilter = ElementCategoryFilter(BuiltInCategory.OST_Levels)
collector = FilteredElementCollector(doc)
mas=collector.WherePasses(levelfilter).WhereElementIsNotElementType().ToElements()
levelmas=[]
#_________________________________________________________________

def cikleLevel(mas):
	levelmas.Clear()
	for level1 in mas:
		if -4000/304.8<level1.GetParameters('Фасад')[0].AsDouble()<-2000/304.8 or level1.GetParameters('Фасад')[0].AsDouble()>=0:
			levelmas.append([level1,level1.GetParameters('Фасад')[0].AsDouble()])
	return levelmas
#_________________________________________________________________
def groupMas(grupNameMas,element):
	try:
		if str(element.Category.Name)[0:3]!='Мат':
			element.GetParameters('ADSK_Группирование')[0].Set(grupNameMas[0])
		else:
			element.GetParameters('ADSK_Группирование')[0].Set(grupNameMas[1])
	except:
		bag.append(["ADSK_Группирование",element])			
	return bag
def adskCount(element):
	try:
		element.GetParameters('ADSK_Количество')[0].Set(element.GetParameters('Длина')[0].AsDouble()*304.8/1000*koefZap)
	except:
		bag.append(["ADSK_Количество",element])			
	return bag
def lsrSystemType(element):
	try:
		element.GetParameters('LSR_Тип системы')[0].Set(element.GetParameters('Тип системы')[0].AsValueString())
	except:
		bag.append(["LSR_Тип системы",element])			
	return bag	
def lsrSystemName(element):
	try:
		element.GetParameters('LSR_Имя системы')[0].Set(element.GetParameters('Имя системы')[0].AsString())
	except:
		bag.append(["LSR_Имя системы",element])			
	return bag		
def DirectionType(element,d,l):
	try:
		element.GetParameters('LSR_Тип разводки')[0].Set('Разводка')
		
		if float(re.sub('[^0-9]', '', (element.LookupParameter('Размер').AsString())))>=d: 
			X1_2=element.Location.Curve.GetEndPoint(0).X
			Y1_2=element.Location.Curve.GetEndPoint(0).Y
			Z1_2=element.Location.Curve.GetEndPoint(0).Z
			X2_2=element.Location.Curve.GetEndPoint(1).X
			Y2_2=element.Location.Curve.GetEndPoint(1).Y
			Z2_2=element.Location.Curve.GetEndPoint(1).Z
			if abs(abs(X1_2)-abs(X2_2))<0.5 and abs(abs(Y1_2)-abs(Y2_2))<0.5 and abs(Z1_2-Z2_2)>l/304.8 :
				element.GetParameters('LSR_Тип разводки')[0].Set('Стояк')
	except:
		bag.append(["LSR_Тип разводки",element])			
	return bag	
bag1=[]	
def pipeName(element):
	i=element
	test=[]
	try:
		if str(element.Category.Name)[0:3]=='Мат':
			element.LookupParameter('ADSK_Наименование').Set(str(element.Name)+' Толщиной '+str(int(element.LookupParameter('Толщина изоляции').AsDouble()*304.8))+'мм для трубы '+str(element.LookupParameter('Размер воздуховода').AsString()))
					
		if str(element.Category.Name)[0:3]=='Гиб':	
			element.LookupParameter('ADSK_Наименование').Set(str(element.FlexDuctType.LookupParameter('Комментарии к типоразмеру').AsString())+' ⌀'+str(element.LookupParameter('Диаметр').AsValueString()))
	
	except:
		bag.append(["ADSK_Наименование",element])	
			
	
	if element.Category.Name[0:3]=='Воз':
		text0='Воздуховод из тонколистовой оцинкованной стали'#, Ø 200 толщиной S=0,5мм
		try:
			#2
			if i.LookupParameter('Имя системы').AsString()[0:2]=='ДВ':
				text='толщиной S='+t+'мм'
				try:
					d='Ø '+i.LookupParameter('Диаметр').AsValueString()
				except:
					d=i.LookupParameter('Ширина').AsValueString()+'x'+i.LookupParameter('Высота').AsValueString()
					
				i.LookupParameter('ADSK_Наименование').Set(text0+' '+d+' '+text)
			elif i.Name[0:1]=='С' and i.LookupParameter('Имя системы').AsString()[0:2]!='ДВ':
				try:
					d=i.LookupParameter('Диаметр').AsValueString()
				
					if int(d)<=250:# and str(i.LookupParameter('Тип изоляции').HasValue)!='True' :
						text='толщиной S=0,5мм'
					if 300<=int(d)<=1000:# and str(i.LookupParameter('Тип изоляции').HasValue)!='True':
						text='толщиной S=0,7мм'
					if 1250<=int(d)<=2000:
						text='толщиной S=0,9'		
				except:
					if int(i.LookupParameter('Ширина').AsValueString())<=250 and int(i.LookupParameter('Высота').AsValueString())<=250 :
						text='толщиной S=0,5мм'
					if 300<=int(i.LookupParameter('Ширина').AsValueString())<=1000 or 300<=int(i.LookupParameter('Высота').AsValueString())<=1000 :
						text='толщиной S=0,7мм'
					if 1250<=int(i.LookupParameter('Ширина').AsValueString())<=2000 or 1250<=int(i.LookupParameter('Высота').AsValueString())<=2000:
						text='толщиной S=0,9мм'	
				try:
					d='Ø '+i.LookupParameter('Диаметр').AsValueString()
				except:
					d=i.LookupParameter('Ширина').AsValueString()+'x'+i.LookupParameter('Высота').AsValueString()
					
				i.LookupParameter('ADSK_Наименование').Set(text0+' '+d+' '+text)
	
			else: 
	
				try:
					d=i.LookupParameter('Диаметр').AsValueString()
				
					if int(d)<=250:# and str(i.LookupParameter('Тип изоляции').HasValue)!='True' :
						text='толщиной S=0,5мм'
					if 300<=int(d)<=1000:# and str(i.LookupParameter('Тип изоляции').HasValue)!='True':
						text='толщиной S=0,7мм'
					if 1250<=int(d)<=2000:
						text='толщиной S=0,9'		
				except:
					if int(i.LookupParameter('Ширина').AsValueString())<=250 and int(i.LookupParameter('Высота').AsValueString())<=250 :
						text='толщиной S=0,5мм'
					if 300<=int(i.LookupParameter('Ширина').AsValueString())<=1000 or 300<=int(i.LookupParameter('Высота').AsValueString())<=1000 :
						text='толщиной S=0,7мм'
					if 1250<=int(i.LookupParameter('Ширина').AsValueString())<=2000 or 1250<=int(i.LookupParameter('Высота').AsValueString())<=2000:
						text='толщиной S=0,9мм'	
				try:
					d='Ø '+i.LookupParameter('Диаметр').AsValueString()
				except:
					d=i.LookupParameter('Ширина').AsValueString()+'x'+i.LookupParameter('Высота').AsValueString()
					
				i.LookupParameter('ADSK_Наименование').Set(text0+' '+d+' '+text)
		except:
			bag1.append(i)	
		
	return bag1
def pipeMarka(element):
	try:
					
		if str(element.Category.Name)[0:3]=='Воз' and str(element.PipeType.LookupParameter('ADSK_Марка').AsString())=="None":
			element.DuctType.LookupParameter('ADSK_Марка').Set(str(element.LookupParameter('Материал').AsValueString()))
		if str(element.Category.Name)[0:3]=='Гиб':	
			element.FlexPipeType.LookupParameter('ADSK_Марка').Set(str(element.FlexDuctType.LookupParameter('Комментарии к типоразмеру').AsString()))
	except:
		bag.append(["ADSK_Марка",element])			
	return bag		
	

	
count=0
test=[]
levelmas2=cikleLevel(mas)
levelCount=len(levelmas2)

bag=[]
levelMas0=[]
linemas01=[]
linemas0=[]
for filter in line_filter_mas:
	collector = FilteredElementCollector(doc)
	lineMas0=collector.WherePasses(filter).WhereElementIsNotElementType().ToElements()
	
	for line in lineMas0:
		pipeCurve = line.Location.Curve; point0=pipeCurve.GetEndPoint(0);point1=pipeCurve.GetEndPoint(1) 
		point0x=point0.X; point0y=point0.Y; point0z=point0.Z
		point1x=point1.X; point1y=point1.Y;	point1z=point1.Z
		dx=point0x-point1x;	dy=point0y-point1y;	dz=(point0z+point1z)/2
		
		zpoint=dz
		linemas01.append([line,zpoint])
TransactionManager.Instance.EnsureInTransaction(doc)
count=0
test=[]
levelCount=len(cikleLevel(mas))
levelmas2=cikleLevel(mas)


sorted_list = sorted(levelmas2, key=lambda x: ( x[1]))
test1=[]
for i in linemas01:
	
	count=0
	groupMas(ADSK_gr,i[0])
	adskCount(i[0])
	lsrSystemType(i[0])
	lsrSystemName(i[0])
	DirectionType(i[0],minD,minH)
	test1.append(pipeName(i[0]))
	pipeMarka(i[0])
	
	try:	
		while count<(levelCount-1):
			k=sorted_list[count][1]
			k1=sorted_list[count+1][1]
			if i[1]<0 :
				try:
					i[0].GetParameters('Базовый уровень')[0].Set(sorted_list[0][0].Id)
				except:
					bag.append(["ADSK_Этаж",i[0]])
				i[0].GetParameters('ADSK_Этаж')[0].Set('-01')
			elif k<i[1]<k1 :
				try:
					i[0].GetParameters('Базовый уровень')[0].Set(sorted_list[count][0].Id)
				except:
					bag.append(["ADSK_Этаж",i[0]])
				i[0].GetParameters('ADSK_Этаж')[0].Set('0'+str(count))
			elif i[1]>sorted_list[len(sorted_list)-1][1]:
				try:
					i[0].GetParameters('Базовый уровень')[0].Set(sorted_list[len(sorted_list)-1][0].Id)
				except:
					bag.append(["ADSK_Этаж",i[0]])	
				i[0].GetParameters('ADSK_Этаж')[0].Set('Кровля')
			count=count+1
	except:
		bag.append(["ADSK_Этаж",i[0]])		
TransactionManager.Instance.ForceCloseTransaction()


t=bag1
t1=dir(t)
# Назначьте вывод переменной OUT.
OUT = test1
# ----------------------------------------
watch = Watch(python_script_2)
boolean_2 = BoolSelector(false)  # graph input

# group: 1
code_block_3 = CodeBlock { "1. Оборудование"; }
code_block_4 = CodeBlock { "4. Воздухораспределители"; }
python_script_3 = Python(IN[0]=code_block_3, IN[1]=code_block_4)  # IronPython2; same code as python_script

python_script_4 = Python(IN[0]=boolean_2, IN[1]=python_script_3)  # IronPython2
# ---------- python_script_4.python (172 lines) ----------
# Загрузить стандартную библиотеку Python и библиотеку DesignScript
import sys
import clr
clr.AddReference('ProtoGeometry')
from Autodesk.DesignScript.Geometry import *
clr.AddReference('RevitAPI')
import Autodesk
from Autodesk.Revit.DB import *
clr.AddReference("RevitServices")
import RevitServices
from RevitServices.Persistence import DocumentManager
from RevitServices.Transactions import TransactionManager
from System.Collections.Generic import List
import math
#from threading import Thread
import time
#----------------------------------------------
#line___________________________________________________________

mechlEquip_f=ElementCategoryFilter(BuiltInCategory.OST_MechanicalEquipment)
vozduh_f=ElementCategoryFilter(BuiltInCategory.OST_DuctTerminal)

#massive_____________________________________________________________________
line_filter_mas=[]
line_filter_mas.append(mechlEquip_f)
line_filter_mas.append(vozduh_f)


# Введенные в этом узле данные сохраняется в виде списка в переменных IN.
dataEnteringNode = IN
#Elem = UnwrapElement(IN[0])
ADSK_gr=UnwrapElement(IN[1])
# Разместите код под этой строкой
doc = DocumentManager.Instance.CurrentDBDocument
uiapp = DocumentManager.Instance.CurrentUIApplication
app = uiapp.Application
bag=[]


k=0
levcountbild=1
levelfilter = ElementCategoryFilter(BuiltInCategory.OST_Levels)
collector = FilteredElementCollector(doc)
mas=collector.WherePasses(levelfilter).WhereElementIsNotElementType().ToElements()
levelmas=[]
znach=[]

def cikleLevel(mas):
	levelmas.Clear()
	for level1 in mas:
		if -4000/304.8<level1.GetParameters('Фасад')[0].AsDouble()<-2000/304.8 or level1.GetParameters('Фасад')[0].AsDouble()>=0:
			levelmas.append([level1,level1.GetParameters('Фасад')[0].AsDouble()])
	return levelmas
def groupMas(grupNameMas,element):
	try:
		if str(element.Category.Name)[0:3]!='Сан':
			element.GetParameters('ADSK_Группирование')[0].Set(grupNameMas[0])
		else:
			element.GetParameters('ADSK_Группирование')[0].Set(grupNameMas[1])
	except:
		bag.append(["ADSK_Группирование",element])			
	return bag
def adskCount(element):
	try:
		element.GetParameters('ADSK_Количество')[0].Set(1)
	except:
		bag.append(["ADSK_Количество",element])			
	return bag
def lsrSystemType(element):
	try:
		element.GetParameters('LSR_Тип системы')[0].Set(element.GetParameters('Классификация систем')[0].AsString())
	except:
		bag.append(["LSR_Тип системы",element])			
	return bag	
def lsrSystemName(element):
	try:
		element.GetParameters('LSR_Имя системы')[0].Set(str(element.GetParameters('Имя системы')[0].AsString())[0:2])
	except:
		bag.append(["LSR_Имя системы",element])			
	return bag	

def edinIzmer(element):
	try:
		element.Symbol.GetParameters('ADSK_Единица измерения')[0].Set('шт.')
	except:
		bag.append(["ADSK_Единица измерения",element])			
	return bag		
TransactionManager.Instance.EnsureInTransaction(doc)
count=0
test=[]
levelCount=len(cikleLevel(mas))
levelmas2=cikleLevel(mas)
linemas0=[]
sorted_list = sorted(levelmas2, key=lambda x: ( x[1]))
for filter in line_filter_mas:
	collector = FilteredElementCollector(doc)
	for line in collector.WherePasses(filter).WhereElementIsNotElementType().ToElements():
		zpoint=line.Location.Point.Z
		linemas0.append([line,zpoint])
		i=line
		if filter==vozduh_f:
			try:
				oldName=i.Symbol.LookupParameter('Комментарии к типоразмеру').AsString()
				size=i.LookupParameter('Размер').AsString().split("-")
				newName=i.LookupParameter('ADSK_Наименование').Set(oldName+'  '+size[0])
				oldNameMark=i.Symbol.LookupParameter('Имя типа').AsString()
				i.Symbol.LookupParameter('ADSK_Марка').Set(oldNameMark+' '+size[0])
			except:
				try:
					newName=i.LookupParameter('ADSK_Наименование').Set(i.Symbol.LookupParameter('Имя типа').AsString())
				except:
					bag.append(i)
		
bag=[]	
for i in linemas0:
	count=0
	groupMas(ADSK_gr,i[0])
	adskCount(i[0])
	lsrSystemType(i[0])
	lsrSystemName(i[0])
	while count<(levelCount-1):
		
		k=sorted_list[count][1]
		k1=sorted_list[count+1][1]
		
		
		#
		if i[1]+200/304.8<0 :
			try:
				i[0].LookupParameter('Отметка от уровня').Set(i[1]-sorted_list[0][1])
				i[0].GetParameters('Уровень')[1].Set(sorted_list[0][0].Id)
				i[0].GetParameters('ADSK_Этаж')[0].Set('-01')
			except:
				bag.append(i[0])
		
		elif k<i[1]+200/304.8<k1:
			try:
				i[0].LookupParameter('Отметка от уровня').Set(i[1]-k)
				i[0].GetParameters('Уровень')[1].Set(sorted_list[count][0].Id)
				i[0].GetParameters('ADSK_Этаж')[0].Set('0'+str(count))
			except:
				bag.append(i[0])
		
		elif i[1]>sorted_list[len(sorted_list)-1][1]:
			try:
				i[0].LookupParameter('Отметка от уровня').Set(i[1]-sorted_list[len(sorted_list)-1][1])
				i[0].GetParameters('Уровень')[1].Set(sorted_list[len(sorted_list)-1][0].Id)
				i[0].GetParameters('ADSK_Этаж')[0].Set('Кровля')
			except:
				bag.append(i[0])
			
		
			
			
		count=count+1
			





		
		
			
t=linemas0#bag#linemas0[0][0].GetParameters('Отметка от уровня')[0].Set(20000)
TransactionManager.Instance.ForceCloseTransaction()



t1=dir(t)
# Назначьте вывод переменной OUT.
OUT = t,t1
# ----------------------------------------
watch_2 = Watch(python_script_4)
boolean_3 = BoolSelector(false)  # graph input

# group: 2
code_block_5 = CodeBlock { "2. Арматура воздуховодов"; }
code_block_6 = CodeBlock { "5.  Соединительные детали воздуховодов"; }
python_script_5 = Python(IN[0]=code_block_5, IN[1]=code_block_6)  # IronPython2; same code as python_script

python_script_6 = Python(IN[0]=boolean_3, IN[1]=python_script_5)  # IronPython2
# ---------- python_script_6.python (265 lines) ----------
# Загрузить стандартную библиотеку Python и библиотеку DesignScript
import sys
import clr
clr.AddReference('ProtoGeometry')
from Autodesk.DesignScript.Geometry import *
clr.AddReference('RevitAPI')
import Autodesk
from Autodesk.Revit.DB import *
clr.AddReference("RevitServices")
import RevitServices
from RevitServices.Persistence import DocumentManager
from RevitServices.Transactions import TransactionManager
from System.Collections.Generic import List
import math
#from threading import Thread
import time
#----------------------------------------------
#line___________________________________________________________
pipe_filter=ElementCategoryFilter(BuiltInCategory.OST_PipeCurves)
duct_filter=ElementCategoryFilter(BuiltInCategory.OST_DuctCurves)

#-----------------------------------------------------------------
#OV_VK___________________________________________________________________
ductFitting_f=ElementCategoryFilter(BuiltInCategory.OST_DuctFitting)
pipeFitting_f=ElementCategoryFilter(BuiltInCategory.OST_PipeFitting)

mechanicalEquipment_f=ElementCategoryFilter(BuiltInCategory.OST_MechanicalEquipment)
pipeaccs_f=ElementCategoryFilter(BuiltInCategory.OST_PipeAccessory)
ductaccs_f=ElementCategoryFilter(BuiltInCategory.OST_DuctAccessory)

#massive_____________________________________________________________________
line_filter_mas=[]
line_filter_mas.append(ductFitting_f)
line_filter_mas.append(ductaccs_f)



#line_filter_mas.append(cableTray_filter)



# Введенные в этом узле данные сохраняется в виде списка в переменных IN.
dataEnteringNode = IN
ADSK_gr=UnwrapElement(IN[1])
#Elem = UnwrapElement(IN[0])

# Разместите код под этой строкой
doc = DocumentManager.Instance.CurrentDBDocument
uiapp = DocumentManager.Instance.CurrentUIApplication
app = uiapp.Application
test=[]


k=0
levcountbild=1
levelfilter = ElementCategoryFilter(BuiltInCategory.OST_Levels)
collector = FilteredElementCollector(doc)
mas=collector.WherePasses(levelfilter).WhereElementIsNotElementType().ToElements()
levelmas=[]
znach=[]
bag=[]
def cikleLevel(mas):
	levelmas.Clear()
	for level1 in mas:
		if -4000/304.8<level1.GetParameters('Фасад')[0].AsDouble()<-2000/304.8 or level1.GetParameters('Фасад')[0].AsDouble()>=0:
			levelmas.append([level1,level1.GetParameters('Фасад')[0].AsDouble()])
	return levelmas
def groupMas(grupNameMas,element):
	try:
		if str(element.Category.Name)[0:3]!='Сое':
			element.GetParameters('ADSK_Группирование')[0].Set(grupNameMas[0])
		else:
			element.GetParameters('ADSK_Группирование')[0].Set(grupNameMas[1])
	except:
		bag.append(["ADSK_Группирование",element])			
	return bag
def adskCount(element):
	try:
		element.GetParameters('ADSK_Количество')[0].Set(1)
	except:
		bag.append(["ADSK_Количество",element])			
	return bag
def lsrSystemType(element):
	try:
		element.GetParameters('LSR_Тип системы')[0].Set(element.GetParameters('Тип системы')[0].AsValueString())
	except:
		bag.append(["LSR_Тип системы",element])			
	return bag	
def lsrSystemName(element):
	try:
		element.GetParameters('LSR_Имя системы')[0].Set(str(element.GetParameters('Имя системы')[0].AsString())[0:2])
	except:
		bag.append(["LSR_Имя системы",element])			
	return bag	

def edinIzmer(element):
	try:
		element.Symbol.GetParameters('ADSK_Единица измерения')[0].Set('шт.')
	except:
		bag.append(["ADSK_Единица измерения",element])			
	return bag		
def adskNameR(element):		
	i=element
	n=(i.LookupParameter('Размер').AsString()).split("-")
	rsplitMas=[]	
	ssplitMas=[]
		
	try:
		for j in i.MEPModel.ConnectorManager.Connectors:
			ktest = 0
			for j1 in j.AllRefs:
				ktest = 21
				#test.append([i.LookupParameter('Размер').AsString().split("-")[0],j1.Owner.LookupParameter('Размер').AsString().split("-")[0]])
				
				if i.LookupParameter('Размер').AsString().split("-")[0]!=j1.Owner.LookupParameter('Размер').AsString().split("-")[0]:
					ktest = 1
					rsplitMas.append(j1.Owner.LookupParameter('Размер').AsString().split("-"))
					ktest = 2
						
		if 	len(rsplitMas)>0:
			ktest = 3
			#test.append(i)	
			if rsplitMas[0][0][0:1]=='⌀':
				ktest = 4
				d2=	rsplitMas[0][0]
				i.LookupParameter('ADSK_Наименование').Set('Врезка воротник'+' '+n[0]+'/'+d2)
				ktest = 5
			else:
				ktest = 6
				d2=	rsplitMas[0][0]
				i.LookupParameter('ADSK_Наименование').Set('Врезка стакан'+' '+n[0]+'/'+d2)		
				ktest = 7
		elif len(rsplitMas[0])==0:
			ktest = 8
			if rsplitMas[0][0][0:1]=='⌀':
				
				i.LookupParameter('ADSK_Наименование').Set('Врезка воротник'+' '+n[0]+'/'+n[0])
			else:
				
				i.LookupParameter('ADSK_Наименование').Set('Врезка стакан'+' '+n[0]+'/'+n[0])	
	except:
		test.append(i)
		test.append(ktest)
	if len(i.LookupParameter('ADSK_Наименование').AsString())==0 and i.LookupParameter('Размер').AsString()[0:1]=='⌀':
		i.LookupParameter('ADSK_Наименование').Set('Врезка воротник'+' '+n[0]+'/'+n[0])
	elif len(i.LookupParameter('ADSK_Наименование').AsString())==0 and i.LookupParameter('Размер').AsString()[0:1]!='⌀':
		i.LookupParameter('ADSK_Наименование').Set('Врезка стакан'+' '+n[0]+'/'+n[0])	
				
	return test	
TransactionManager.Instance.EnsureInTransaction(doc)
count=0

levelCount=len(cikleLevel(mas))
levelmas2=cikleLevel(mas)
linemas0=[]
test=[]
sorted_list = sorted(levelmas2, key=lambda x: ( x[1]))

m = []



for filter in line_filter_mas:

	collector = FilteredElementCollector(doc)
	
	for line in collector.WherePasses(filter).WhereElementIsNotElementType().ToElements():
		zpoint=line.Location.Point.Z
		linemas0.append([line,zpoint])
		i=line
		if 	filter==ductaccs_f:
			try:
				oldName=i.Symbol.LookupParameter('Комментарии к типоразмеру').AsString()
				size=i.LookupParameter('Размер').AsString().split("-")
				newName=i.LookupParameter('ADSK_Наименование').Set(oldName+'  '+size[0])
				"""
				oldNameMark=i.Symbol.LookupParameter('Имя типа').AsString()
				i.Symbol.LookupParameter('ADSK_Марка').Set(oldNameMark+' '+size[0])
				"""
			except:
				bag.append(["Ошибки в аксесуарах",i])
			try:
				i.LookupParameter('ADSK_Количество').Set(i.LookupParameter('Число').AsDouble()*304.8)	
			except:
				bag.append(["Ошибки в аксесуарах",i])
		if 	filter==ductFitting_f:
			
			name2=i.Symbol.LookupParameter('Комментарии к типоразмеру').AsString()	
			
			d=i.LookupParameter('Размер').AsString()
			try:
				if name2[0:5]=='Отвод':
					
					n=(i.LookupParameter('Размер').AsString()).split("-")
							
					
					e=i.LookupParameter('MC Fitting Angle').AsValueString()
					#test.append(i)		
					i.LookupParameter('ADSK_Наименование').Set('Отвод'+'-'+e+' '+str(n[0]))
					
				elif name2[0:5]=='Перех':
					n=i.LookupParameter('Размер').AsString()
					i.LookupParameter('ADSK_Наименование').Set('Переход'+' '+n)
				elif name2[0:5]=='Заглу':
					n=i.LookupParameter('Размер').AsString()
					i.LookupParameter('ADSK_Наименование').Set('Заглушка'+' '+n)			
				elif name2[0:5]=='Тройн':
					n=i.LookupParameter('Размер').AsString()	
					i.LookupParameter('ADSK_Наименование').Set('Тройник'+' '+n)	
				elif name2[0:5]=='Врезк':
					adskNameR(i)
			except:
				pass
		
for i in linemas0:
	count=0
	groupMas(ADSK_gr,i[0])
	adskCount(i[0])
	lsrSystemType(i[0])
	lsrSystemName(i[0])
	edinIzmer(i[0])
	while count<(levelCount-1):
		
		k=sorted_list[count][1]
		k1=sorted_list[count+1][1]
		
		
		#
		if i[1]<0 :
			try:
				i[0].GetParameters('Уровень')[1].Set(sorted_list[0][0].Id)
				i[0].GetParameters('ADSK_Этаж')[0].Set('-01')
				
			except:
				pass
		elif k<i[1]<k1:
		
			try:
				
				i[0].GetParameters('Уровень')[1].Set(sorted_list[count][0].Id)
				i[0].GetParameters('ADSK_Этаж')[0].Set('0'+str(count))
				
			except:
				pass	
		elif i[1]>sorted_list[len(sorted_list)-1][1]:
			try:
				i[0].GetParameters('Уровень')[1].Set(sorted_list[len(sorted_list)-1][0].Id)
				i[0].GetParameters('ADSK_Этаж')[0].Set('Кровля')
			except:
				pass
			
		count=count+1






TransactionManager.Instance.ForceCloseTransaction()


t=bag#levelmas2[len(levelmas2)-1][1]
t1=dir(t)
# Назначьте вывод переменной OUT.
OUT = test #t,t1
# ----------------------------------------
watch_3 = Watch(python_script_6)
