# Dynamo graph тест доставка параметра из фопа.dyn (Dynamo 2.12.1.8246)

boolean = BoolSelector(true)
python_script = Python(IN[0]=boolean)  # CPython3
# ---------- python_script.python (78 lines) ----------
import clr
clr.AddReference('RevitAPI')
clr.AddReference('RevitServices')
from Autodesk.Revit.DB import *
from RevitServices.Persistence import DocumentManager
from RevitServices.Transactions import TransactionManager


doc = DocumentManager.Instance.CurrentDBDocument

sharedParamsFile = doc.Application.SharedParametersFilename

# ФОП
paramFile = doc.Application.OpenSharedParameterFile()


def findParameter(paramName):
    for group in paramFile.Groups:
        for definition in group.Definitions:
            if definition.Name == paramName:
                return definition
    return None


def parameterExistsInFamily(paramName):
    for param in doc.FamilyManager.GetParameters():
        if param.Definition.Name == paramName:
            return param
    return None


parameters_to_add = [
    'HT_ТХ ТЗ МГ',
    'HT_ТХ ТЗ ОВИК',
    'HT_ТХ ТЗ СС',
    'HT_ТХ ТЗ ЭОМ',
    'HT_ТХ_Раздел шаблона',
    'HT_ТХ_ТЗ ВК'
]

results = []  


TransactionManager.Instance.EnsureInTransaction(doc)

try:
    for paramName in parameters_to_add:
        
        familyParam = parameterExistsInFamily(paramName)
        if familyParam is not None:
            results.append(f"Параметр '{paramName}' уже существует в семействе.")
            continue
        
        
        parameterDef = findParameter(paramName)
        
        
        if parameterDef is None:
            results.append(f"Параметр '{paramName}' не найден в файле общих параметров")
            continue
        
        
        isInstance = False  
        
        
        result = doc.FamilyManager.AddParameter(parameterDef, BuiltInParameterGroup.PG_TEXT, isInstance)
        if result:
            results.append(f"Параметр '{paramName}' успешно добавлен как параметр типа")
        else:
            results.append(f"Не удалось добавить параметр '{paramName}'")

    TransactionManager.Instance.TransactionTaskDone()
except Exception as e:
    TransactionManager.Instance.TransactionTaskDone()
    results.append(f"Ошибка при добавлении параметров: {str(e)}")


results
# ----------------------------------------
watch = Watch(python_script)
