# Dynamo graph тест работа с параметрами ОВ2.dyn (Dynamo 2.12.1.8246)

boolean = BoolSelector(true)
python_script = Python(IN[0]=boolean)  # IronPython2
# ---------- python_script.python (59 lines) ----------
import clr, System
clr.AddReference("RevitNodes")
import Revit
clr.AddReference('RevitAPI')
from Autodesk.Revit.DB import *
clr.AddReference("RevitServices")
from RevitServices.Persistence import DocumentManager
from RevitServices.Transactions import TransactionManager
from System.Collections.Generic import List
import math
doc = DocumentManager.Instance.CurrentDBDocument
uiapp = DocumentManager.Instance.CurrentUIApplication
app = uiapp.Application
view = doc.ActiveView
#-------------------------------------------------------------------
category=[]
collector = FilteredElementCollector(doc)
eqipfilter = ElementCategoryFilter(BuiltInCategory.OST_MechanicalEquipment)

#________________________________________________________________

collector = FilteredElementCollector(doc)
equpment = collector.WherePasses(eqipfilter).WhereElementIsNotElementType().ToElements()
TransactionManager.Instance.EnsureInTransaction(doc)
test = []

#mas=equpment[862].GetDependentElements(pipefit)	
for i1 in equpment:
	
	SubEleemnt=i1.GetDependentElements(eqipfilter)
	#test.append(i1.LookupParameter('Имя системы').AsValueString())
	#test.append(i1)
	name=str(i1.LookupParameter('Имя системы').AsValueString())
	i1.LookupParameter('HT_ИмяСистемы').Set(str(i1.LookupParameter('Имя системы').AsValueString()))
	if len(SubEleemnt)>1 :
		for j in SubEleemnt:
			element = doc.GetElement(j)
			
			rez=element.LookupParameter('MVS_Имя_Системы').Set(name)
			
			
			n1=element.LookupParameter('MVS_Имя_Системы').AsString()
			
			test.append([element,name,rez,n1])
			"""
			try:
				element.LookupParameter('HT_ИмяСистемы').Set(str(i1.LookupParameter('Имя системы').AsValueString()))
			except:
				bag.append(['LSR_Имя системы LSR_Тип системы',i])

	
"""					


TransactionManager.Instance.TransactionTaskDone()

t=test#equpment[862].GetDependentElements(pipefit)
t1=dir(t)
OUT=t
# ----------------------------------------
watch = Watch(python_script)
code_block = CodeBlock {  }
