# Dynamo graph удаление отверстий на одном месте 2 rvt_v22.dyn (Dynamo 2.12.0.5650)

# group: Штамп
# note: Скрипт предназначен для удаления дублирующихся отверстий
# note: Script Name: удаление отверстий на одном месте 2 rvt_v22
# Packages used in this script:
# TimeStamp : 2024/2/27 9:40

code_block = CodeBlock()
# ---------- code_block.designscript (11 lines) ----------
"Воздуховоды";
"Трубы";
"Кабельные лотки";
"Уровни";
"Телефонные устройства";
"Соединительные детали трубопроводов";
"Оборудование";
"Линии";
"Короба";
"Сантехнические приборы";
"Обобщенные модели";
# ----------------------------------------

# group: Отверстия(телефонные устройства)
byName = Category.ByName(name=code_block.out10)
отверстия = ElementsOfCategory(Category=byName)

watch = Watch(отверстия)
watch_2 = Watch(watch)
watch_3 = Watch()  # unwired: arg0
code_block_2 = CodeBlock { "АР"; "КР"; }
удаление_копий = Python(IN[0]=watch_2, IN[1]=watch_3, IN[2]=code_block_2.out0)  # IronPython2
# ---------- удаление_копий.python (128 lines) ----------
import clr, System

clr.AddReference('ProtoGeometry')
from Autodesk.DesignScript.Geometry import *
clr.AddReference("RevitNodes")
import Revit
clr.AddReference('RevitAPI')
import Autodesk
from Autodesk.Revit.DB import *
clr.AddReference("RevitServices")
from RevitServices.Persistence import DocumentManager
from RevitServices.Transactions import TransactionManager
from System.Collections.Generic import List
import math

doc = DocumentManager.Instance.CurrentDBDocument
uiapp = DocumentManager.Instance.CurrentUIApplication
app = uiapp.Application
view = doc.ActiveView


#-------------------------------------------------------------------
# Опции для работы функций
opt = Options() # Для получения геометрии
optS = SolidCurveIntersectionOptions() # Для нахождения пересечения объёмного тела с кривой
nonStr = Autodesk.Revit.DB.Structure.StructuralType.NonStructural # Для вставки семейства в основу

#----------------------------------------------------------
open_tel = UnwrapElement(IN[0])


dmas=[]
opmas=[]
connectors=[]
unicmas=[]
pointcounty1=[]
#Открыти транзакции----------------------------------------

TransactionManager.Instance.EnsureInTransaction(doc)
#TTTTTTTTTTTTTTTTTTTTTTTTTTTTTTTTTTTTTTTTTTTTTTTTTTTTTTTTTTT
"""
for duct in ducts:
	if str(duct.Id)=='1105959':
		dmas.append(duct)
"""		
for i in open_tel:
	
	data=(i,i.Location.Point)
	unicmas.append(data)
	pointcounty1.append(i.Location.Point)		
		
pointcounty=[]
unique_numbers = set(pointcounty1)
for number in unique_numbers:
	pointcounty.append(number)
pointcounty.sort()
mas1=[]
mas2=[]
for i in pointcounty:
	for j in unicmas:
		if str(j[1])==str(i):# and i.LookupParameter('GP_Opn_Габариты')==j[1].LookupParameter('GP_Opn_Габариты'):
			mas1.append(j[0])
	if len(mas1)>1:
		k=0
		for i1 in mas1:
			if k!=0:
				mas2.append(i1)
			k=k+1
	mas1.Clear()			
"""		
for i in dmas[0].ConnectorManager.Connectors:
	connectors.append(i)				
#--------------------------------------------
#newline=Line.CreateBound(new1, new2)

zeropoint=XYZ(0,0,0)

z1=opmas[0].Location.Point.Z
equpment=dmas[0]
boxmin=equpment.BoundingBox[view].Min
boxminx=equpment.BoundingBox[view].Min.X
boxminy=equpment.BoundingBox[view].Min.Y
boxminz=equpment.BoundingBox[view].Min.Z
		
#--------------------------------------------
boxmax=equpment.BoundingBox[view].Max
boxmaxx=equpment.BoundingBox[view].Max.X
boxmaxy=equpment.BoundingBox[view].Max.Y
boxmaxz=equpment.BoundingBox[view].Max.Z
#--------------------------------------------
boxcentx=(boxminx+boxmaxx)/2
boxcenty=(boxminy+boxmaxy)/2
boxcentz=(boxminz+boxmaxz)/2
newline3=Line.CreateBound(XYZ(boxminx,boxcenty,boxcentz),XYZ(boxmaxx,boxcenty,boxcentz))
newline4=Line.CreateBound(XYZ(boxcentx,boxminy,boxcentz),XYZ(boxcentx,boxmaxy,boxcentz))
newline1=Line.CreateBound(XYZ(boxminx,boxminy,opmas[0].Location.Point.Z),XYZ(boxmaxx,boxmaxy,opmas[0].Location.Point.Z))
newline2=Line.CreateBound(opmas[0].Location.Point,XYZ(100,0,opmas[0].Location.Point.Z))#dmas[0].Location.Curve.Origin
end0 = newline3.GetEndPoint(0)
end1 = newline3.GetEndPoint(1)
x0_ = end0.X; y0_ = end0.Y;	x1_ = end1.X; y1_ = end1.Y; z0_ = end0.Z; z1_ = end1.Z
A2 = y0_-y1_; B2 = x1_-x0_; C2 = z1_-z0_

endWall0 = newline2.GetEndPoint(0) # Получение начальной точки кривой
endWall1 = newline2.GetEndPoint(1) # Получение конечной точки кривой
x0 = endWall0.X; y0 = endWall0.Y; x1 = endWall1.X; y1 = endWall1.Y # Получение отдельных координат точек
A1 = y0-y1;	B1 = x1-x0 # Получение коэффициентов уравнения прямой

D = ((A1**2 + B1**2)**0.5 * (A2**2 + B2**2)**0.5)
if D != 0:
	cosin = (A1*A2 + B1*B2) / D # Вычисление косинуса между прямыми трубы и стены
	if math.fabs(cosin) <= 1:
		angleHor = math.degrees(math.acos(cosin))		

		#newline3=Line.CreateBound(boxmin,boxmax)
t=connectors[0].CoordinateSystem.BasisX
t01=connectors[0].CoordinateSystem.BasisY
t03=opmas[0].FacingOrientation.AngleTo(t)
opmas[0].Location.Rotate(dmas[0].Location.Curve,(math.radians(90)+t03))#Location.Point.AngleOnPlaneTo(connectors[0].Origin,zeropoint)
#.CoordinateSystem.BasisX.AngleTo(open_tel[1].Location.Point)
t0=newline1.Direction#connectors[0].Origin.AngleTo(opmas[0].Location.Point)#.Rotate(dmas[0].Location.Curve,t)#Rotation#(dmas[0].Location.Curve,math.radians(47))#math.radians(47))
#open_tel[1].Location.Rotate(dmas[0].Location.Curve,math.radians(angleHor))

#ion#ducts[1011]#open_tel[37]#FacingOrientation#.AngleTo(ducts[1011].Location.Curve.GetEndPoint(1))#BasePoint #.BoundingBox[view]
t1=dir(t)	
"""
TransactionManager.Instance.TransactionTaskDone()

OUT=mas2#t03,math.radians(132.19),t0,t01,t,t1#lst,lst2,openmas,rf,almasducts[1011]#
# ----------------------------------------
delete = Element.Delete(element=удаление_копий)
оборудование = Watch(delete)
оборудование_2 = Watch(удаление_копий)
